# Grasshopper definition joint_connector_generalized.gh (Grasshopper 1.0.7)
# plug-ins: Kangaroo2 Components, DendroGH

python = GhPythonScript()  # -> out, cd
# ---------- python: Python ----------
path = ghenv.Component.OnPingDocument().FilePath

separator = '/'
split = path.split(separator)
print split

if len(split) < 2:
    separator = '\\'
    split = path.split(separator)

cd = separator.join(split[:-3]) + separator + "mesh" + separator
# ---------- end python ----------
python_2 = GhPythonScript()  # -> out, cd
# ---------- python_2: Python ----------
__author__ = "ytakzk"
__version__ = "2018.12.04"

path = ghenv.Component.OnPingDocument().FilePath

separator = '/'
split = path.split(separator)
print split

if len(split) < 2:
    separator = '\\'
    split = path.split(separator)

cd = separator.join(split[:-1]) + separator
# ---------- end python_2 ----------
panel = Panel(python_2.cd)
panel_2 = Panel(python.cd)
python_script = PythonScript(cd=python.cd)  # -> out, vertices, faces
# ---------- python_script: Python ----------
import Rhino.Geometry as rg
file = open(cd + 'mesh.obj')
lines = file.readlines()
vertices=[]
faces=[]
for line in lines:
    if line.find("v")==0 and line.find("n")==-1 and line.find("t")==-1:
        print line.split(' ')
        vertices.Add(rg.Point3d(float((line.split(' '))[1]),float((line.split(' '))[2]),float((line.split(' '))[3])))
    if line.find("f")==0:
        if line.split(' ').Count==4:
            faces.Add(rg.MeshFace(int(line.split(' ')[1].split('/')[0])-1,int(line.split(' ')[2].split('/')[0])-1,int(line.split(' ')[3].split('/')[0])-1))
        if line.split(' ').Count==5:
            faces.Add(rg.MeshFace(int(line.split(' ')[1].split('/')[0])-1,int(line.split(' ')[2].split('/')[0])-1,int(line.split(' ')[3].split('/')[0])-1,int(line.split(' ')[4].split('/')[0])-1))
# ---------- end python_script ----------
construct_mesh = ConstructMesh(Vertices=python_script.vertices, Faces=python_script.faces)
mesh = Mesh(construct_mesh)  # disabled
joint_outer_radius = Slider(25, range=0..100)
python_3 = GhPythonScript(m=mesh)  # -> out, pairs, vertices; inputs m: Mesh
# ---------- python_3: Python ----------
__author__ = "ytakzk"
__version__ = "2018.12.06"

import Rhino.Geometry as rg
import clr
clr.AddReference("Grasshopper")
import Grasshopper.Kernel.Data.GH_Path as ghpath
import Grasshopper.DataTree as datatree
import System

pairs = datatree[System.Object]()
vertices = datatree[System.Object]()

for i, v in enumerate(m.TopologyVertices):
    
    induces = m.TopologyVertices.ConnectedTopologyVertices(i)

    path = ghpath(i)

    for v in induces:
        vertex = m.TopologyVertices[v]
        pairs.Add(vertex, path)
    
    vertices.Add(m.TopologyVertices[i], path)
# ---------- end python_3 ----------

# ---- group: size of the table
bbox = BoundingBox(Content=mesh, Plane=PlaneXY(0, 0, 0))  # -> Box, Box_2
debox = DeconstructBox(Box=bbox.Box)  # -> Plane, X, Y, Z
dedomain = DeconstructDomain(Domain=[debox.X, debox.Y, debox.Z])  # -> Start, End
subtraction = Subtraction(A=dedomain.End, B=dedomain.Start)
panel_3 = Panel(subtraction)

# ---- group: rods
medges = MeshEdges(Mesh=mesh)  # -> NakedEdges, InteriorEdges, NonManifoldEdges
merge = Merge(Data1=medges.NakedEdges, Data2=medges.InteriorEdges, Data3=medges.NonManifoldEdges)
pipe = Pipe(Curve=merge, Radius=Slider(2.5, range=0..10), Caps=0)
cap = CapHoles(Brep=pipe)

# ----
ln = Line(StartPoint=python_3.pairs, EndPoint=python_3.vertices)
sph = Sphere(Base=python_3.vertices, Radius=joint_outer_radius)
crv = Curve(ln)
srf = Surface(sph)
scx = SurfaceCurve(Surface=srf, Curve=crv)  # -> Curves, Points, UVPoints, Normals, Parameters, Tangents
pshift = ShiftPaths(Data=scx.Points, Offset=-1)
pshift_2 = ShiftPaths(Data=scx.Normals, Offset=-1)
dist = Distance(PointA=pshift, PointB=python_3.vertices)
shift = ShiftList(List=pshift, Shift=1, Wrap=True)
division = Division(A=dist, B=Slider(2, range=0..10))
geodesic = Geodesic(Surface=srf, Start=pshift, End=shift)
line = LineSDL(Start=pshift, Direction=expr("x*-1", pshift_2), Length=division)
ln_2 = Line(StartPoint=pshift, EndPoint=shift)
planar = Planar(Curve=geodesic)  # -> Planar, Plane, Deviation
eval = EvaluateCurve(Curve=reparameterize(ln_2), Parameter=0.5)  # -> Point, Tangent, Angle
pl_origin = PlaneOrigin(Base=planar.Plane, Origin=eval.Point)
panel_4 = Panel(planar.Plane)
viewer = ParamViewer(planar.Plane)
sec = BrepPlane(Brep=srf, Plane=simplify(planar.Plane))  # -> Curves, Points
panel_5 = Panel(pl_origin)
viewer_2 = ParamViewer(pl_origin)
item = TreeItem(Tree=sec.Curves, Path="{0;0}", Index=Slider(10, range=0..10), Wrap=True)
viewer_3 = ParamViewer(sec.Curves)
vsettings = CreateSettings(VoxelSize=Slider(0.5, range=0..1), Bandwidth=1, Isovalue=0.002, Adaptivity=0.1)
pshift_3 = ShiftPaths(Data=sec.Curves, Offset=-1)
item_2 = ListItem(List=division, Index=0, Wrap=True)
viewer_4 = ParamViewer(pshift_3)
vcurve = CurveToVolume(Curves=line, CurveRadius=Slider(2.6, range=0..10), Settings=vsettings)
vcurve_2 = CurveToVolume(Curves=line, CurveRadius=Slider(5, range=0..10), Settings=vsettings)
vcurve_3 = CurveToVolume(Curves=pshift_3, CurveRadius=Slider(4, range=0..10), Settings=vsettings)
vpoints = PointsToVolume(Points=python_3.vertices, PointRadius=item_2, Settings=vsettings)
vpoints_2 = PointsToVolume(Points=python_3.vertices, PointRadius=joint_outer_radius, Settings=vsettings)
vint = VolumeIntersection(VolumeA=vpoints_2, VolumesB=vcurve_3)
vint_2 = VolumeIntersection(VolumeA=vpoints_2, VolumesB=vcurve_2)
vunion = VolumeUnion(Volumes=[vint_2, vpoints, vint])
vdiff = VolumeDifference(VolumeA=vunion, VolumesB=vcurve)
mvolume = VolumeToMesh(Volume=vint, VolumeSettings=vsettings)
mvolume_2 = VolumeToMesh(Volume=vdiff, VolumeSettings=vsettings)
clean = CombineClean(Meshes=mvolume_2)  # disabled
